# Grasshopper definition 220227_Spatial greenhouse_Aggregation_reduced.gh (Grasshopper 1.0.7)
# plug-ins: Kangaroo Components

line = Line(Line((0, 9, 0), (0, 9, 2.75)))
len = Length(Curve=line)

# ---- group: RH_IN:Modules
number_slider = Slider(17, range=1..592)

# ----
addition = Addition(A=len, B="2")
mesh = Mesh(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)
mesh_2 = Mesh(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)
division = Division(A=addition, B=len)
x_0_1 = Number(expr("x+0.1", division))
bbox = BoundingBox(Content=mesh_2, Plane=PlaneXY(0, 0, 0))  # -> Box, Box_2
modules = GetNumber(number_slider, AtLeast=1, AtMost=1, Maximum=1.797693135e+308, Minimum=-1.797693135e+308)
box = EvaluateBox(Box=bbox.Box, UParameter=0.5, VParameter="1", WParameter=0.5)  # -> Plane, Point, Include
scale_nu = ScaleNU(Geometry=mesh, Plane=PlaneXY(0, 0, 0), ScaleX=x_0_1, ScaleY="1", ScaleZ=x_0_1)  # -> Geometry, Transform
scale = Scale(Geometry=mesh_2, Center=box.Point, Factor=x_0_1)  # -> Geometry, Transform
xz = XZPlane(Origin=Point(0, 0, 0))
mirror = Mirror(Geometry=scale.Geometry, Plane=xz)  # -> Geometry, Transform
merge = Merge(Data1=scale.Geometry, Data2=scale_nu.Geometry)
merge_2 = Merge(Data1=scale.Geometry, Data2=mirror.Geometry, Data3=scale_nu.Geometry)
bbox_2 = BoundingBox(Content=flatten(merge), Plane=PlaneXY(0, 0, 0), UnionBox=True)  # -> Box, Box_2
clean = CombineClean(Meshes=flatten(merge_2))
panel = Panel("""0.5
0""")
panel_2 = Panel("""0.5
0.5""")
panel_3 = Panel("""0.5
1""")
box_2 = EvaluateBox(Box=bbox_2.Box, UParameter=panel, VParameter=panel_2, WParameter=panel_3)  # -> Plane, Point, Include
item = ListItem(List=box_2.Point, Index=0, Wrap=True)  # -> Item, Item1
vec2pt = Vector2Pt(PointA=item.Item, PointB=item.Item1, Unitize=False)  # -> Vector, Length

# ----
# STRUCTURE TO BE COMPLETED
entwine = Entwine(Branch00=scale_nu.Geometry, Branch01=mesh, FlattenInputs=True)
medges = MeshEdges(Mesh=mesh)  # -> NakedEdges, InteriorEdges, NonManifoldEdges
join = JoinCurves(Curves=medges.NakedEdges, Preserve=False)
panel_4 = Panel("""1/4
1/2
3/4""")
medges_2 = MeshEdges(Mesh=entwine)  # -> NakedEdges, InteriorEdges, NonManifoldEdges
join_2 = JoinCurves(Curves=medges_2.NakedEdges, Preserve=False)
disc = Discontinuity(Curve=join_2, Level=1)  # -> simplify(Points), Parameters
path_mapper = PathMapper(disc.Points, source="{A;B}(i)", target="{A;i}(B)")
item_2 = ListItem(List=path_mapper, Index=0, Wrap=True)  # -> Item, Item1
multiplication = Multiplication(A=item_2.Item, B=reverse(panel_4))
multiplication_2 = Multiplication(A=item_2.Item1, B=panel_4)
addition_2 = Addition(A=multiplication, B=multiplication_2)
path_mapper_2 = PathMapper(addition_2, source="{A;B}(i)", target="{A;i}(B)")
pline = PolyLine(Vertices=path_mapper_2, Closed=True)
pshift = ShiftPaths(Data=pline, Offset=-1)
panel_5 = Panel("""0
1
1
1
0""")
weave = Weave(Pattern=panel_5, Stream0=join_2, Stream1=pshift, NullGaps=False)
flip = FlipMatrix(Data=weave)
explode = Explode(Curve=flip, Recursive=True)  # -> Segments, Vertices
cullpt = CullDuplicates(Points=explode.Vertices, Tolerance=0.1, CullMode=3)  # -> Points, Indices, Valence
trim = TrimTree(Tree=cullpt.Points, Depth=1)
bang = ExplodeTree(Data=weave)  # -> _0000, _0100
split = SplitTree(Data=trim, Masks=flatten("{*; 0}"))  # -> Positive, Negative
dispatch = Dispatch(List=bang._0100, DispatchPattern=[True, False])  # -> ListA, ListB
explode_2 = Explode(Curve=dispatch.ListA, Recursive=True)  # -> Segments, Vertices
area = Area(Geometry=dispatch.ListA)  # -> Area, Centroid
item_3 = ListItem(List=area.Centroid, Index=0, Wrap=True)  # -> Item, Item1
cullpt_2 = CullDuplicates(Points=explode_2.Vertices, Tolerance=0.1, CullMode=3)  # -> Points, Indices, Valence
vec2pt_2 = Vector2Pt(PointA=item_3.Item, PointB=item_3.Item1, Unitize=False)  # -> Vector, Length
circle = CircleCNR(Center=area.Centroid, Normal=vec2pt_2.Vector, Radius="0.6")  # -> graft(Circle)
crv_cp = CurveClosestPoint(Point=cullpt_2.Points, Curve=circle)  # -> Point, Parameter, Distance
trim_2 = TrimTree(Tree=crv_cp.Point, Depth=1)
dispatch_2 = Dispatch(List=trim_2, DispatchPattern=[True, False])  # -> ListA, ListB
split_2 = SplitTree(Data=dispatch_2.ListA, Masks=flatten("{*; 0}"))  # -> Positive, Negative
ln = Line(StartPoint=split.Positive, EndPoint=split.Negative)
ln_2 = Line(StartPoint=cullpt_2.Points, EndPoint=trim_2)
ln_3 = Line(StartPoint=split_2.Positive, EndPoint=split_2.Negative)

medges_3 = MeshEdges(Mesh=clean)  # -> NakedEdges, InteriorEdges, NonManifoldEdges
medges_4 = MeshEdges(Mesh=mesh)  # -> NakedEdges, InteriorEdges, NonManifoldEdges
crv = Curve(flatten([pshift, ln, ln_2, ln_3, circle, medges_3.NakedEdges, medges_3.InteriorEdges, medges_4.NakedEdges, medges_4.InteriorEdges]))
panel_6 = Panel("""0.5
0""")
panel_7 = Panel("""0.5
0.5""")
panel_8 = Panel("""0.5
1""")
multiplication_3 = Multiplication(A="3", B="6")
arrbox = BoxArray(Geometry=bbox_2.Box, Cell=bbox_2.Box, XCount="2", YCount="1", ZCount="2")  # -> Geometry, Transform
arrbox_2 = BoxArray(Geometry=bbox_2.Box, Cell=bbox_2.Box, XCount="6", YCount="3", ZCount="6")  # -> Geometry, Transform
box_3 = EvaluateBox(Box=bbox_2.Box, UParameter=panel_6, VParameter=panel_7, WParameter=panel_8)  # -> Plane, Point, Include
partition = PartitionList(List=arrbox_2.Geometry, Size=multiplication_3)
group = Group(Objects=arrbox.Geometry)
bbox_3 = BoundingBox(Content=arrbox.Geometry, Plane=PlaneXY(0, 0, 0), UnionBox=True)  # -> Box, Box_2
lng = ListLength(List=arrbox.Geometry)
item_4 = ListItem(List=box_3.Point, Index=0, Wrap=True)  # -> Item, Item1
partition_2 = PartitionList(List=partition, Size="6")  # -> simplify(Chunks)
division_2 = Division(A="32", B=lng)
vec2pt_3 = Vector2Pt(PointA=item_4.Item, PointB=item_4.Item1, Unitize=False)  # -> Vector, Length
cbrt = CubeRoot(Value=division_2)
round = Round(Number=cbrt)  # -> Nearest, Floor, Ceiling
split_3 = SplitTree(Data=partition_2, Masks=flatten("{*;0, 2, 4...}"))  # -> Positive, Negative
move = Move(Geometry=split_3.Negative, Motion=vec2pt_3.Vector)  # -> Geometry, Transform
num = Number(expr("x-1", "6"))
arrbox_3 = BoxArray(Geometry=group, Cell=bbox_3.Box, XCount=round.Ceiling, YCount=round.Ceiling, ZCount=round.Ceiling)  # -> Geometry, Transform
concat = Concatenate(FragmentA="{", FragmentB=num, FragmentC=";*}")
partition_3 = PartitionList(List=arrbox_3.Geometry, Size=round.Ceiling)  # -> simplify(Chunks)
split_4 = SplitTree(Data=move.Geometry, Masks=flatten(concat))  # -> Positive, Negative
split_5 = SplitList(List=split_4.Negative, Index="1")  # -> ListA, ListB
trim_3 = TrimTree(Tree=split_5.ListB, Depth=1)
split_6 = SplitTree(Data=partition_3, Masks=flatten("{1, 3}"))  # -> Positive, Negative
merge_3 = Merge(Data1=split_3.Positive, Data2=trim_3)
move_2 = Move(Geometry=split_6.Positive, Motion=vec2pt.Vector)  # -> Geometry, Transform
split_7 = SplitList(List=flatten(merge_3), Index=Slider(50, range=0..100))  # -> ListA, ListB
geo = Geometry(split_7.ListA)
merge_4 = Merge(Data1=move_2.Geometry, Data2=split_6.Negative)
ungroup = Ungroup(Group=merge_4)
partition_4 = PartitionList(List=ungroup, Size="2")
split_8 = SplitTree(Data=partition_4, Masks=flatten("{*; 0}"))  # -> flatten(Positive), flatten(Negative)
partition_5 = PartitionList(List=split_8.Positive, Size="8")
partition_6 = PartitionList(List=split_8.Negative, Size="8")
box_4 = EvaluateBox(Box=bbox_2.Box, UParameter=0.5, VParameter=0.5, WParameter=0.5)  # -> Plane, Point, Include
mesh_3 = Mesh(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)
group_2 = Group(Objects=crv)
merge_5 = Merge(Data1=partition_5, Data2=partition_6)  # -> flatten(Result)
split_9 = SplitList(List=merge_5, Index=modules)  # -> ListA, ListB
box_5 = EvaluateBox(Box=split_9.ListA, UParameter=0.5, VParameter=0.5, WParameter=0.5)  # -> Plane, Point, Include
demesh = DeconstructMesh(Mesh=mesh_3)  # -> Vertices, Faces, Colours, Normals
rev = Reverse(Vector=demesh.Normals)
conmesh = ConstructMesh(Vertices=demesh.Vertices, Faces=demesh.Faces, Colours=rev)
orient = Orient(Geometry=group_2, Source=box_4.Plane, Target=box_5.Plane)  # -> Geometry, Transform
orient_2 = Orient(Geometry=conmesh, Source=box_4.Plane, Target=box_5.Plane)  # -> Geometry, Transform
ungroup_2 = Ungroup(Group=orient.Geometry)

# ---- group: RH_OUT:Structure
crv_2 = Curve(ungroup_2)

# ---- group: RH_OUT:Pots
mesh_4 = Mesh(orient_2.Geometry)
