# Grasshopper definition 220227_Spatial greenhouse_test01.gh (Grasshopper 1.0.7)
# plug-ins: Kangaroo Components, Kangaroo2 Components

# ---- group: Max root size
number_slider = Slider(2, range=0.5..2)

# ---- group: Number of modules
number_slider_2 = Slider(2, range=1..4)

# ----
modules = GetNumber(number_slider_2, AtLeast=1, AtMost=1, Maximum=1.797693135e+308, Minimum=-1.797693135e+308)
root = GetNumber(number_slider, AtLeast=1, AtMost=1, Maximum=1.797693135e+308, Minimum=-1.797693135e+308)
height_max = Panel("""1.5
0.5
3
2
0.5
2.2
0.7
1.3
1
1
0.6
0.45
0.5
0.5
2.5
0.6
0.5
1.5
1
0.6
0.3""")
# CROP: SOJA
# CHICKPEAS
# COMMON BEANS
# PEAS
# LENTILS
# SUNFLOWER
# LINSEED
# WHEAT
# RICE
# POTATO
# PARSLEY
# DILL
# CINNAMON BASIL
# LETTUCE
# CUCUMBER
# CABBAGE
# BOK CHOY
# ONIONS
# RADISHES
# BRASSICA RAPA
# GARLIC
temp_av = Panel("""20
22.5
25
18
20
21.5
17
17
25
15
18
14.5
22.5
17
21.5
18.5
17
23
20
19.5
18.5""")
ph_av = Panel("""7.5
6.75
6.25
6.75
6.75
6
5.75
6.25
6.5
6.25
7.25
6.15
5.95
7.05
6.25
6
6.75
6.5
6.15
6.5
6.5""")
water_mm = Panel("""600
400
600
450
420
140
400
400
1000
450
400
450
400
500
400
500
400
640
450
400
330""")
# NUTRIENTS: PROTEINS
# PROTEINS
# PROTEINS
# PROTEINS
# PROTEINS
# OILS
# OILS
# CARBS
# CARBS
# CARBS
# FLAVOUR
# FLAVOUR
# FLAVOUR
# WATER AND FIBRE
# WATER AND FIBRE
# WATER AND FIBRE
# WATER AND FIBRE
# HEALTH
# HEALTH
# HEALTH
# HEALTH
rooting = Panel("""0.5
0.5
1.7
0.2
0.5
2
0.4
1
0.4
0.6
0.15
0.5
0.5
0.25
1.2
0.6
0.3
0.6
0.2
0.3
0.5""")
smaller = SmallerThan(FirstNumber=rooting, SecondNumber=root)  # -> SmallerThan, OrEqualTo
cull = CullPattern(List=rooting, CullPattern=smaller.OrEqualTo)
bnd = Bounds(Numbers=cull)
dedomain = DeconstructDomain(Domain=bnd)  # -> Start, End
python = GhPythonScript(x=dedomain.End)  # -> out, a
# ---------- python: Python ----------
if x < 0.75:
    a = 0.75
else:
    a = x
# ---------- end python ----------
line = Line(Line((0, 9, 0), (0, 9, 2.75)))
len = Length(Curve=line)
addition = Addition(A=len, B=python.a)
mesh = Mesh(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)
mesh_2 = Mesh(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)
division = Division(A=addition, B=len)
x_0_1 = Number(expr("x+0.1", division))
x_0_2 = Number(expr("x+0.2", x_0_1))
crv = Curve([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])
mesh_3 = Mesh(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)
bbox = BoundingBox(Content=mesh, Plane=PlaneXY(0, 0, 0))  # -> Box, Box_2
scale_nu = ScaleNU(Geometry=mesh_2, Plane=PlaneXY(0, 0, 0), ScaleX=x_0_2, ScaleY="1", ScaleZ=x_0_2)  # -> Geometry, Transform
box = EvaluateBox(Box=bbox.Box, UParameter=0.5, VParameter="1", WParameter=0.5)  # -> Plane, Point, Include
scale_nu_2 = ScaleNU(Geometry=mesh_2, Plane=PlaneXY(0, 0, 0), ScaleX=x_0_1, ScaleY="1", ScaleZ=x_0_1)  # -> Geometry, Transform

# ----
# STRUCTURE TO BE COMPLETED
entwine = Entwine(Branch00=scale_nu_2.Geometry, Branch01=mesh_2, FlattenInputs=True)
medges = MeshEdges(Mesh=mesh_2)  # -> NakedEdges, InteriorEdges, NonManifoldEdges
join = JoinCurves(Curves=medges.NakedEdges, Preserve=False)
panel = Panel("""1/4
1/2
3/4""")
medges_2 = MeshEdges(Mesh=entwine)  # -> NakedEdges, InteriorEdges, NonManifoldEdges
join_2 = JoinCurves(Curves=medges_2.NakedEdges, Preserve=False)
disc = Discontinuity(Curve=join_2, Level=1)  # -> simplify(Points), Parameters
path_mapper = PathMapper(disc.Points, source="{A;B}(i)", target="{A;i}(B)")
item = ListItem(List=path_mapper, Index=0, Wrap=True)  # -> Item, Item1
multiplication = Multiplication(A=item.Item, B=reverse(panel))
multiplication_2 = Multiplication(A=item.Item1, B=panel)
addition_2 = Addition(A=multiplication, B=multiplication_2)
path_mapper_2 = PathMapper(addition_2, source="{A;B}(i)", target="{A;i}(B)")
pline = PolyLine(Vertices=path_mapper_2, Closed=True)
pshift = ShiftPaths(Data=pline, Offset=-1)
panel_2 = Panel("""0
1
1
1
0""")
weave = Weave(Pattern=panel_2, Stream0=join_2, Stream1=pshift, NullGaps=False)
flip = FlipMatrix(Data=weave)
explode = Explode(Curve=flip, Recursive=True)  # -> Segments, Vertices
cullpt = CullDuplicates(Points=explode.Vertices, Tolerance=0.1, CullMode=3)  # -> Points, Indices, Valence
trim = TrimTree(Tree=cullpt.Points, Depth=1)
bang = ExplodeTree(Data=weave)  # -> _0000, _0100
split = SplitTree(Data=trim, Masks=flatten("{*; 0}"))  # -> Positive, Negative
dispatch = Dispatch(List=bang._0100, DispatchPattern=[True, False])  # -> ListA, ListB
explode_2 = Explode(Curve=dispatch.ListA, Recursive=True)  # -> Segments, Vertices
area = Area(Geometry=dispatch.ListA)  # -> Area, Centroid
item_2 = ListItem(List=area.Centroid, Index=0, Wrap=True)  # -> Item, Item1
cullpt_2 = CullDuplicates(Points=explode_2.Vertices, Tolerance=0.1, CullMode=3)  # -> Points, Indices, Valence
vec2pt = Vector2Pt(PointA=item_2.Item, PointB=item_2.Item1, Unitize=False)  # -> Vector, Length
circle = CircleCNR(Center=area.Centroid, Normal=vec2pt.Vector, Radius="0.6")  # -> graft(Circle)
crv_cp = CurveClosestPoint(Point=cullpt_2.Points, Curve=circle)  # -> Point, Parameter, Distance
trim_2 = TrimTree(Tree=crv_cp.Point, Depth=1)
dispatch_2 = Dispatch(List=trim_2, DispatchPattern=[True, False])  # -> ListA, ListB
split_2 = SplitTree(Data=dispatch_2.ListA, Masks=flatten("{*; 0}"))  # -> Positive, Negative
ln = Line(StartPoint=split.Positive, EndPoint=split.Negative)
ln_2 = Line(StartPoint=cullpt_2.Points, EndPoint=trim_2)
ln_3 = Line(StartPoint=split_2.Positive, EndPoint=split_2.Negative)

demesh = DeconstructMesh(Mesh=scale_nu.Geometry)  # -> Vertices, Faces, Colours, Normals
scale = Scale(Geometry=crv, Center=box.Point, Factor=x_0_2)  # -> Geometry, Transform
scale_2 = Scale(Geometry=mesh_3, Center=box.Point, Factor=x_0_2)  # -> Geometry, Transform
deface = DeconstructFace(Face=demesh.Faces)  # -> graft(CornerA), graft(CornerB), graft(CornerC), graft(CornerD)
scale_3 = Scale(Geometry=mesh, Center=box.Point, Factor=x_0_1)  # -> Geometry, Transform
xz = XZPlane(Origin=Point(0, 0, 0))
item_3 = ListItem(List=demesh.Vertices, Index=[deface.CornerA, deface.CornerB, deface.CornerC, deface.CornerD], Wrap=True)
mirror = Mirror(Geometry=scale.Geometry, Plane=xz)  # -> Geometry, Transform
mirror_2 = Mirror(Geometry=scale_2.Geometry, Plane=xz)  # -> Geometry, Transform
mirror_3 = Mirror(Geometry=scale_3.Geometry, Plane=xz)  # -> Geometry, Transform
item_4 = ListItem(List=item_3, Index=0, Wrap=True)  # -> Item, Item1, Item2, Item3
merge = Merge(Data1=scale_3.Geometry, Data2=mirror_3.Geometry, Data3=flatten(scale_nu_2.Geometry))
srf4pt = _4PointSurface(CornerA=item_4.Item, CornerB=item_4.Item1, CornerC=item_4.Item2, CornerD=item_4.Item3)
mesh_uv = MeshSurface(Surface=srf4pt, UCount="2", VCount="12", Overhang=True, Equalize=False)  # -> flatten(Mesh)
clean = CombineClean(Meshes=flatten(merge))
medges_3 = MeshEdges(Mesh=mesh_uv)  # -> NakedEdges, InteriorEdges, NonManifoldEdges
medges_4 = MeshEdges(Mesh=clean)  # -> NakedEdges, InteriorEdges, NonManifoldEdges
medges_5 = MeshEdges(Mesh=mesh_2)  # -> NakedEdges, InteriorEdges, NonManifoldEdges
relay = Relay([medges_4.NakedEdges, medges_4.InteriorEdges])
relay_2 = Relay([medges_5.NakedEdges, medges_5.InteriorEdges])
crv_2 = Curve(flatten([ln_2, ln_3, circle, ln, pshift, relay_2, relay]))
mp = MultiPipe(
    Curves=flatten([scale.Geometry, mirror.Geometry, medges_3.InteriorEdges]),
    NodeSize=".05",
    EndOffset=1,
    StrutSize=1,
    Segment=0,
    KinkAngle=0.6,
    CubeFit=0,
    Caps=0)
entwine_2 = Entwine(Branch00=mp, Branch01=[scale_2.Geometry, mirror_2.Geometry], Branch02=mesh_uv, FlattenInputs=True)
group = Group(Objects=entwine_2)
explode_3 = Explode(Curve=crv_2, Recursive=True)  # -> Segments, Vertices
mp_2 = MultiPipe(Curves=explode_3.Segments, NodeSize=".05", EndOffset=1, StrutSize=1, Segment=0, KinkAngle=0.6, CubeFit=0, Caps=0)  # -> flatten(Pipe)
bbox_2 = BoundingBox(Content=flatten(clean), Plane=PlaneXY(0, 0, 0), UnionBox=True)  # -> Box, Box_2
arrbox = BoxArray(Geometry=bbox_2.Box, Cell=bbox_2.Box, XCount="2", YCount="1", ZCount="2")  # -> Geometry, Transform
split_3 = SplitList(List=arrbox.Geometry, Index=modules)  # -> ListA, ListB
box_2 = EvaluateBox(Box=split_3.ListA, UParameter=0.5, VParameter=0.5, WParameter=0.5)  # -> Plane, Point, Include
box_3 = EvaluateBox(Box=bbox_2.Box, UParameter=0.5, VParameter=0.5, WParameter=0.5)  # -> Plane, Point, Include
group_2 = Group(Objects=mp_2)
orient = Orient(Geometry=group, Source=box_3.Plane, Target=box_2.Plane)  # -> Geometry, Transform
orient_2 = Orient(Geometry=group_2, Source=box_3.Plane, Target=box_2.Plane)  # -> Geometry, Transform
ungroup = Ungroup(Group=orient_2.Geometry)  # -> flatten(Objects)
ungroup_2 = Ungroup(Group=orient.Geometry)
pshift_2 = ShiftPaths(Data=ungroup_2, Offset=-1)
split_4 = SplitTree(Data=pshift_2, Masks=flatten("{*; 0}"))  # -> Positive, Negative
split_5 = SplitTree(Data=split_4.Negative, Masks=flatten("{*; 1}"))  # -> Positive, Negative
medges_6 = MeshEdges(Mesh=split_5.Negative)  # -> NakedEdges, InteriorEdges, NonManifoldEdges
mesh_4 = Mesh(flatten([split_5.Positive, split_5.Negative]))
subd = SubD(split_4.Positive)

# ---- group: Layers
# PH grouping
number_slider_3 = Slider(1, range=0..3)

# ----
skin = GetInteger(number_slider_3, AtLeast=1, AtMost=1, Maximum=2147483647, Minimum=-2147483648)
mcol = MeshColours(Mesh=subd, Colours="LightGray")
mcol_2 = MeshColours(Mesh=mesh_4, Colours="White")
mcol_3 = MeshColours(Mesh=mesh_4, Colours=ColourSwatch(SwatchColor=RGBA(255, 255, 255, 100)))
mcol_4 = MeshColours(Mesh=ungroup, Colours="LightGray")
filter = StreamFilter(Gate=skin, Stream0=[mcol_2, mcol], Stream1=[mcol_3, mcol, mcol_4], Stream2=mcol_4)

# ---- group: RH_OUT:skin
mesh_5 = Mesh(filter)
