# Grasshopper definition 220227_Spatial greenhouse+aggregation.gh (Grasshopper 1.0.7)
# plug-ins: Kangaroo Components, Kangaroo2 Components, Weaverbird

# ---- group: Max root size
number_slider = Slider(2, range=0.5..2)

# ---- group: Number of modules
number_slider_2 = Slider(4, range=1..4)

# ----
modules = GetNumber(number_slider_2, AtLeast=1, AtMost=1, Maximum=1.797693135e+308, Minimum=-1.797693135e+308)
root = GetNumber(number_slider, AtLeast=1, AtMost=1, Maximum=1.797693135e+308, Minimum=-1.797693135e+308)
crop = Panel("""SOJA
CHICKPEAS
COMMON BEANS
PEAS
LENTILS
SUNFLOWER
LINSEED
WHEAT
RICE
POTATO
PARSLEY
DILL
CINNAMON BASIL
LETTUCE
CUCUMBER
CABBAGE
BOK CHOY
ONIONS
RADISHES
BRASSICA RAPA
GARLIC""")
height_max = Panel("""1.5
0.5
3
2
0.5
2.2
0.7
1.3
1
1
0.6
0.45
0.5
0.5
2.5
0.6
0.5
1.5
1
0.6
0.3""")
temp_av = Panel("""20
22.5
25
18
20
21.5
17
17
25
15
18
14.5
22.5
17
21.5
18.5
17
23
20
19.5
18.5""")
ph_av = Panel("""7.5
6.75
6.25
6.75
6.75
6
5.75
6.25
6.5
6.25
7.25
6.15
5.95
7.05
6.25
6
6.75
6.5
6.15
6.5
6.5""")
water_mm = Panel("""600
400
600
450
420
140
400
400
1000
450
400
450
400
500
400
500
400
640
450
400
330""")
nutrients = Panel("""PROTEINS
PROTEINS
PROTEINS
PROTEINS
PROTEINS
OILS
OILS
CARBS
CARBS
CARBS
FLAVOUR
FLAVOUR
FLAVOUR
WATER AND FIBRE
WATER AND FIBRE
WATER AND FIBRE
WATER AND FIBRE
HEALTH
HEALTH
HEALTH
HEALTH""")
rooting = Panel("""0.5
0.5
1.7
0.2
0.5
2
0.4
1
0.4
0.6
0.15
0.5
0.5
0.25
1.2
0.6
0.3
0.6
0.2
0.3
0.5""")
smaller = SmallerThan(FirstNumber=rooting, SecondNumber=root)  # -> SmallerThan, OrEqualTo
cull = CullPattern(List=rooting, CullPattern=smaller.OrEqualTo)
bnd = Bounds(Numbers=cull)
dedomain = DeconstructDomain(Domain=bnd)  # -> Start, End
python = GhPythonScript(x=dedomain.End)  # -> out, a
# ---------- python: Python ----------
if x < 0.75:
    a = 0.75
else:
    a = x
# ---------- end python ----------
line = Line(Line((0, 9, 0), (0, 9, 2.75)))
len = Length(Curve=line)
addition = Addition(A=len, B=python.a)
cull_2 = CullPattern(List=nutrients, CullPattern=smaller.OrEqualTo)
mesh = Mesh(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)
mesh_2 = Mesh(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)
smaller_2 = SmallerThan(FirstNumber=cull, SecondNumber=Slider(0.2, range=0..1))  # -> SmallerThan, OrEqualTo
cset = CreateSet(List=nutrients)  # -> Set, Map
division = Division(A=addition, B=len)
dispatch = Dispatch(List=cull, DispatchPattern=smaller_2.OrEqualTo)  # -> ListA, ListB
lng = ListLength(List=cset.Set)
x_0_1 = Number(expr("x+0.1", division))
x_0_2 = Number(expr("x+0.2", x_0_1))
crv = Curve([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])
mesh_3 = Mesh(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)
bbox = BoundingBox(Content=mesh, Plane=PlaneXY(0, 0, 0))  # -> Box, Box_2
scale_nu = ScaleNU(Geometry=mesh_2, Plane=PlaneXY(0, 0, 0), ScaleX=x_0_2, ScaleY="1", ScaleZ=x_0_2)  # -> Geometry, Transform
lng_2 = ListLength(List=dispatch.ListA)
mindex = MemberIndex(Set=cull_2, Member=cset.Set)  # -> Index, Count
series = Series(Start=0, Step=1, Count=lng)
dup = DuplicateData(Data="0", Number=lng_2, Order=True)
box = EvaluateBox(Box=bbox.Box, UParameter=0.5, VParameter="1", WParameter=0.5)  # -> Plane, Point, Include
scale_nu_2 = ScaleNU(Geometry=mesh_2, Plane=PlaneXY(0, 0, 0), ScaleX=x_0_1, ScaleY="1", ScaleZ=x_0_1)  # -> Geometry, Transform

# ----
# STRUCTURE TO BE COMPLETED
entwine = Entwine(Branch00=scale_nu_2.Geometry, Branch01=mesh_2, FlattenInputs=True)
medges = MeshEdges(Mesh=mesh_2)  # -> NakedEdges, InteriorEdges, NonManifoldEdges
join = JoinCurves(Curves=medges.NakedEdges, Preserve=False)
panel = Panel("""1/4
1/2
3/4""")
medges_2 = MeshEdges(Mesh=entwine)  # -> NakedEdges, InteriorEdges, NonManifoldEdges
join_2 = JoinCurves(Curves=medges_2.NakedEdges, Preserve=False)
disc = Discontinuity(Curve=join_2, Level=1)  # -> simplify(Points), Parameters
path_mapper = PathMapper(disc.Points, source="{A;B}(i)", target="{A;i}(B)")
item = ListItem(List=path_mapper, Index=0, Wrap=True)  # -> Item, Item1
multiplication = Multiplication(A=item.Item, B=reverse(panel))
multiplication_2 = Multiplication(A=item.Item1, B=panel)
addition_2 = Addition(A=multiplication, B=multiplication_2)
path_mapper_2 = PathMapper(addition_2, source="{A;B}(i)", target="{A;i}(B)")
pline = PolyLine(Vertices=path_mapper_2, Closed=True)
pshift = ShiftPaths(Data=pline, Offset=-1)
panel_2 = Panel("""0
1
1
1
0""")
weave = Weave(Pattern=panel_2, Stream0=join_2, Stream1=pshift, NullGaps=False)
flip = FlipMatrix(Data=weave)
explode = Explode(Curve=flip, Recursive=True)  # -> Segments, Vertices
cullpt = CullDuplicates(Points=explode.Vertices, Tolerance=0.1, CullMode=3)  # -> Points, Indices, Valence
trim = TrimTree(Tree=cullpt.Points, Depth=1)
bang = ExplodeTree(Data=weave)  # -> _0000, _0100
split = SplitTree(Data=trim, Masks=flatten("{*; 0}"))  # -> Positive, Negative
dispatch_2 = Dispatch(List=bang._0100, DispatchPattern=[True, False])  # -> ListA, ListB
explode_2 = Explode(Curve=dispatch_2.ListA, Recursive=True)  # -> Segments, Vertices
area = Area(Geometry=dispatch_2.ListA)  # -> Area, Centroid
item_2 = ListItem(List=area.Centroid, Index=0, Wrap=True)  # -> Item, Item1
cullpt_2 = CullDuplicates(Points=explode_2.Vertices, Tolerance=0.1, CullMode=3)  # -> Points, Indices, Valence
vec2pt = Vector2Pt(PointA=item_2.Item, PointB=item_2.Item1, Unitize=False)  # -> Vector, Length
circle = CircleCNR(Center=area.Centroid, Normal=vec2pt.Vector, Radius="0.6")  # -> graft(Circle)
crv_cp = CurveClosestPoint(Point=cullpt_2.Points, Curve=circle)  # -> Point, Parameter, Distance
trim_2 = TrimTree(Tree=crv_cp.Point, Depth=1)
dispatch_3 = Dispatch(List=trim_2, DispatchPattern=[True, False])  # -> ListA, ListB
flip_2 = FlipMatrix(Data=dispatch_3.ListA)
pline_2 = PolyLine(Vertices=flip_2, Closed=False)
ln = Line(StartPoint=split.Positive, EndPoint=split.Negative)
ln_2 = Line(StartPoint=cullpt_2.Points, EndPoint=trim_2)

demesh = DeconstructMesh(Mesh=scale_nu.Geometry)  # -> Vertices, Faces, Colours, Normals
dup_2 = DuplicateData(Data=graft(series), Number=graft(mindex.Count), Order=True)  # -> flatten(Data)
weave_2 = Weave(Pattern=smaller_2.OrEqualTo, Stream0=dispatch.ListB, Stream1=dup, NullGaps=False)
scale = Scale(Geometry=crv, Center=box.Point, Factor=x_0_2)  # -> Geometry, Transform
scale_2 = Scale(Geometry=mesh_3, Center=box.Point, Factor=x_0_2)  # -> Geometry, Transform
deface = DeconstructFace(Face=demesh.Faces)  # -> graft(CornerA), graft(CornerB), graft(CornerC), graft(CornerD)
scale_3 = Scale(Geometry=mesh, Center=box.Point, Factor=x_0_1)  # -> Geometry, Transform
xz = XZPlane(Origin=Point(0, 0, 0))
item_3 = ListItem(List=demesh.Vertices, Index=[deface.CornerA, deface.CornerB, deface.CornerC, deface.CornerD], Wrap=True)
mirror = Mirror(Geometry=scale.Geometry, Plane=xz)  # -> Geometry, Transform
mirror_2 = Mirror(Geometry=scale_2.Geometry, Plane=xz)  # -> Geometry, Transform
mirror_3 = Mirror(Geometry=scale_3.Geometry, Plane=xz)  # -> Geometry, Transform
item_4 = ListItem(List=item_3, Index=0, Wrap=True)  # -> Item, Item1, Item2, Item3
merge = Merge(Data1=scale_3.Geometry, Data2=mirror_3.Geometry, Data3=flatten(scale_nu_2.Geometry))
srf4pt = _4PointSurface(CornerA=item_4.Item, CornerB=item_4.Item1, CornerC=item_4.Item2, CornerD=item_4.Item3)
mesh_uv = MeshSurface(Surface=srf4pt, UCount="2", VCount="12", Overhang=True, Equalize=False)  # -> flatten(Mesh)
clean = CombineClean(Meshes=flatten(merge))
medges_3 = MeshEdges(Mesh=mesh_uv)  # -> NakedEdges, InteriorEdges, NonManifoldEdges
medges_4 = MeshEdges(Mesh=clean)  # -> NakedEdges, InteriorEdges, NonManifoldEdges
medges_5 = MeshEdges(Mesh=mesh_2)  # -> NakedEdges, InteriorEdges, NonManifoldEdges
relay = Relay([medges_4.NakedEdges, medges_4.InteriorEdges])
relay_2 = Relay([medges_5.NakedEdges, medges_5.InteriorEdges])
mcol = MeshColours(Mesh=flatten([mirror_2.Geometry, scale_2.Geometry, mesh_uv]), Colours="White")
crv_2 = Curve(flatten([ln_2, circle, ln, pshift, relay_2, relay, pline_2]))
mp = MultiPipe(
    Curves=flatten([scale.Geometry, mirror.Geometry, medges_3.InteriorEdges]),
    NodeSize=".05",
    EndOffset=1,
    StrutSize=1,
    Segment=0,
    KinkAngle=0.6,
    CubeFit=0,
    Caps=0)
mcol_2 = MeshColours(Mesh=mp, Colours="LightGray")
merge_2 = Merge(Data1=mcol_2, Data2=mcol)
group = Group(Objects=merge_2)
explode_3 = Explode(Curve=crv_2, Recursive=True)  # -> flatten(Segments), Vertices
medges_6 = MeshEdges(Mesh=mesh_2)  # -> NakedEdges, InteriorEdges, NonManifoldEdges
mp_2 = MultiPipe(Curves=explode_3.Segments, NodeSize=".05", EndOffset=1, StrutSize=1, Segment=0, KinkAngle=0.6, CubeFit=0, Caps=0)  # -> flatten(Pipe)
join_3 = JoinCurves(Curves=medges_6.NakedEdges, Preserve=False)
explode_4 = Explode(Curve=join_3, Recursive=True)  # -> Segments, Vertices
meshsubd = MeshFromSubD(SubD=mp_2, Density="1")
avr = Average(Input=explode_4.Vertices)
crv_3 = Curve(explode_4.Segments)
len_2 = Length(Curve=crv_3)
trim_3 = TrimTree(Tree=avr, Depth=1)
division_2 = Division(A=len_2, B="0.6")
item_5 = ListItem(List=trim_3, Index=0, Wrap=True)  # -> Item, Item1
mcol_3 = MeshColours(Mesh=meshsubd, Colours="LightGray")
divide = DivideCurve(Curve=crv_3, Count=division_2, Kinks=False)  # -> Points, Tangents, Parameters
dist = Distance(PointA=item_5.Item, PointB=item_5.Item1)
trim_4 = TrimTree(Tree=divide.Points, Depth=1)
vec2pt_2 = Vector2Pt(PointA=item_5.Item, PointB=item_5.Item1, Unitize=False)  # -> Vector, Length
division_3 = Division(A=dist, B="0.6")
cullpt_3 = CullDuplicates(Points=trim_4, Tolerance=0.1, CullMode=3)  # -> simplify(Points), Indices, Valence
expression = Expression(x=division_3, Expression="Int(x/4)*4")
split_2 = SplitTree(Data=cullpt_3.Points, Masks=flatten("{*; 0}"))  # -> Positive, Negative
division_4 = Division(A=dist, B=expression)
addition_3 = Addition(A=expression, B=1)
amp = Amplitude(Vector=vec2pt_2.Vector, Amplitude=division_4)
arrlinear = LinearArray(Geometry=split_2.Positive, Direction=amp, Count=addition_3)  # -> simplify(Geometry), Transform
relitem = RelativeItem(Tree=arrlinear.Geometry, Offset="{1}(0)", WrapPaths=invert(False), WrapItems=False)  # -> ItemA, ItemB
shift = ShiftList(List=relitem.ItemA, Shift=1, Wrap=invert(True))
shift_2 = ShiftList(List=relitem.ItemB, Shift=1, Wrap=invert(True))
trim_5 = TrimTree(Tree=shift, Depth=1)
trim_6 = TrimTree(Tree=shift_2, Depth=1)
short = ShortestList(ListA=relitem.ItemA, ListB=relitem.ItemB, ListC=trim_5, TrimMode=2)  # -> ListA, ListB, ListC
bbox_2 = BoundingBox(Content=flatten(clean), Plane=PlaneXY(0, 0, 0), UnionBox=True)  # -> Box, Box_2
merge_3 = Merge(Data1=graft(short.ListA), Data2=graft(trim_5), Data3=graft(trim_6), Data4=graft(short.ListB))
quad = MeshQuad(CornerA=0, CornerB=1, CornerC=2, CornerD=3)
arrbox = BoxArray(Geometry=bbox_2.Box, Cell=bbox_2.Box, XCount="2", YCount="1", ZCount="2")  # -> Geometry, Transform
conmesh = ConstructMesh(Vertices=merge_3, Faces=quad)
trim_7 = TrimTree(Tree=conmesh, Depth=1)
split_3 = SplitList(List=arrbox.Geometry, Index=modules)  # -> ListA, ListB
flip_3 = FlipMatrix(Data=trim_7)  # -> flatten(Data)
box_2 = EvaluateBox(Box=split_3.ListA, UParameter=0.5, VParameter=0.5, WParameter=0.5)  # -> Plane, Point, Include
box_3 = EvaluateBox(Box=bbox_2.Box, UParameter=0.5, VParameter=0.5, WParameter=0.5)  # -> Plane, Point, Include
group_2 = Group(Objects=flip_3)
orient = Orient(Geometry=group_2, Source=box_3.Plane, Target=box_2.Plane)  # -> Geometry, Transform
ungroup = Ungroup(Group=orient.Geometry)  # -> flatten(Objects)
orient_2 = Orient(Geometry=group, Source=box_3.Plane, Target=box_2.Plane)  # -> Geometry, Transform
orient_3 = Orient(Geometry=mcol_3, Source=box_3.Plane, Target=box_2.Plane)  # -> simplify(graft(Geometry)), Transform
ungroup_2 = Ungroup(Group=orient_2.Geometry)  # -> simplify(Objects)
cull_3 = CullPattern(List=temp_av, CullPattern=smaller.OrEqualTo)
cull_4 = CullPattern(List=water_mm, CullPattern=smaller.OrEqualTo)
cull_5 = CullPattern(List=ph_av, CullPattern=smaller.OrEqualTo)
cull_6 = CullPattern(List=crop, CullPattern=smaller.OrEqualTo)
cull_7 = CullPattern(List=height_max, CullPattern=smaller.OrEqualTo)
panel_3 = Panel(cset.Set)
merge_4 = Merge(
    Data1=ColourSwatch(SwatchColor=RGB(0, 255, 187)),
    Data2=ColourSwatch(SwatchColor=RGB(255, 212, 0)),
    Data3=ColourSwatch(SwatchColor=RGB(255, 0, 0)))  # -> graft(Result)

# ---- group: Layers
number_slider_3 = Slider(1, range=0..2)

# ---- group: Diagrams
number_slider_4 = Slider(3, range=0..7)

# ----
skin = GetInteger(number_slider_3, AtLeast=1, AtMost=1, Maximum=2147483647, Minimum=-2147483648)
diagrams = GetInteger(number_slider_4, AtLeast=1, AtMost=1, Maximum=2147483647, Minimum=-2147483648)
filter = StreamFilter(Gate=skin, Stream0=ungroup_2, Stream1=orient_3.Geometry)
agg = GetInteger(Slider(8, range=4..97), AtLeast=1, AtMost=1, Maximum=2147483647, Minimum=-2147483648)
aggregation = GetBoolean(Toggle(True), AtLeast=1, AtMost=1, FalseValue="False", TrueValue="True")
gate = StreamGate(Stream=[scale_3.Geometry, scale_nu_2.Geometry], Gate=aggregation)  # -> Target0, Target1
gate_2 = StreamGate(Stream=filter, Gate=aggregation)  # -> Target0, Target1
mesh_4 = Mesh(simplify(gate_2.Target1))
bbox_3 = BoundingBox(Content=flatten(gate.Target1), Plane=PlaneXY(0, 0, 0), UnionBox=True)  # -> Box, Box_2
panel_4 = Panel("""0.5
0""")
panel_5 = Panel("""0.5
0.5""")
panel_6 = Panel("""0.5
1""")
multiplication_3 = Multiplication(A="3", B="6")
arrbox_2 = BoxArray(Geometry=bbox_3.Box, Cell=bbox_3.Box, XCount="6", YCount="3", ZCount="6")  # -> Geometry, Transform
box_4 = EvaluateBox(Box=bbox_3.Box, UParameter=panel_4, VParameter=panel_5, WParameter=panel_6)  # -> Plane, Point, Include
partition = PartitionList(List=arrbox_2.Geometry, Size=multiplication_3)
item_6 = ListItem(List=box_4.Point, Index=0, Wrap=True)  # -> Item, Item1
partition_2 = PartitionList(List=partition, Size="6")  # -> simplify(Chunks)
vec2pt_3 = Vector2Pt(PointA=item_6.Item, PointB=item_6.Item1, Unitize=False)  # -> Vector, Length
split_4 = SplitTree(Data=partition_2, Masks=flatten("{*;0, 2, 4...}"))  # -> Positive, Negative
move = Move(Geometry=split_4.Negative, Motion=vec2pt_3.Vector)  # -> Geometry, Transform
num = Number(expr("x-1", "6"))
concat = Concatenate(FragmentA="{", FragmentB=num, FragmentC=";*}")
split_5 = SplitTree(Data=move.Geometry, Masks=flatten(concat))  # -> Positive, Negative
split_6 = SplitList(List=split_5.Negative, Index="1")  # -> ListA, ListB
trim_8 = TrimTree(Tree=split_6.ListB, Depth=1)
merge_5 = Merge(Data1=split_4.Positive, Data2=trim_8)
split_7 = SplitList(List=flatten(merge_5), Index=agg)  # -> ListA, ListB
box_5 = Box(split_7.ListA)
box_6 = EvaluateBox(Box=box_5, UParameter=0.5, VParameter=0.5, WParameter=0.5)  # -> Plane, Point, Include

# ----
# In this chunk, I establish the number of plants per type and the number of plants per species
# Different species of
# the same nutrient
nutrient_s_in_diet = Panel("""0.15
0.1
0.5
0.05
0.1
0.1""")
lng_3 = ListLength(List=flatten(ungroup))

# ----
# Number of plants per type
multiplication_4 = Multiplication(A=lng_3, B=nutrient_s_in_diet)

division_5 = Division(A=multiplication_4, B=mindex.Count)
round = Round(Number=division_5)  # -> Nearest, Floor, Ceiling
multiplication_5 = Multiplication(A=division_5, B=mindex.Count)  # -> graft(Result)

# ----
# Number of plants per species
dup_3 = DuplicateData(Data=graft(round.Floor), Number=graft(mindex.Count), Order=True)  # -> flatten(Data)

partition_3 = PartitionList(List=dup_3, Size=mindex.Count)
ma = MassAddition(Input=partition_3)  # -> Result, PartialResults
subtraction = Subtraction(A=multiplication_5, B=ma.Result)

split_8 = SplitList(List=partition_3, Index="1")  # -> ListA, ListB
int = Integer(subtraction)
ma_2 = MassAddition(Input=flatten(int))  # -> Result, PartialResults
ma_3 = MassAddition(Input=flatten(subtraction))  # -> Result, PartialResults
int_2 = Integer(ma_2.Result)
int_3 = Integer(ma_3.Result)
larger = LargerThan(FirstNumber=ma_2.Result, SecondNumber=ma_3.Result)  # -> LargerThan, OrEqualTo
equals = Equality(FirstNumber=int_2, SecondNumber=int_3)  # -> Equality, Inequality
gate_3 = StreamGate(Stream=int, Gate=equals.Equality)  # -> Target0, Target1
subtraction_2 = Subtraction(A=ma_2.Result, B=ma_3.Result)
split_9 = SplitTree(Data=gate_3.Target0, Masks=flatten("{*; 0}"))  # -> Positive, Negative
num_2 = Number(expr("Abs(x)", subtraction_2))
subtraction_3 = Subtraction(A=split_9.Positive, B=num_2)
addition_4 = Addition(A=split_9.Positive, B=num_2)
weave_3 = Weave(Pattern=larger.LargerThan, Stream0=addition_4, Stream1=subtraction_3, NullGaps=False)
merge_6 = Merge(Data1=weave_3, Data2=split_9.Negative)
filter_2 = StreamFilter(Gate=equals.Equality, Stream0=merge_6, Stream1=gate_3.Target1)

addition_5 = Addition(A=filter_2, B=split_8.ListA)

merge_7 = Merge(Data1=addition_5, Data2=split_8.ListB)

trim_9 = TrimTree(Tree=merge_7, Depth=1)  # -> flatten(Tree)
ma_4 = MassAddition(Input=flatten(trim_9))  # -> Result, PartialResults
int_4 = Integer(ma_4.Result)

sort = SortList(
    AVT=cull_3,
    ValuesWATER=cull_4,
    ValuesAVPH=cull_5,
    ValuesNames=cull_6,
    ValuesROOTS=weave_2,
    ValuesHMAX=cull_7,
    ValuesNUTRIENT=dup_2,
    ValuesPLANTSPERSPECIES=trim_9)  # -> AVT, ValuesWATER, ValuesAVPH, ValuesNames, ValuesROOTS, ValuesHMAX, ValuesNUTRIENT, ValuesPLANTSPERSPECIES
bnd_2 = Bounds(Numbers=sort.AVT)
div = DivideDomain(Domain=bnd_2, Count="3")
fdom = FindDomain(Domains=div, Number=sort.AVT, Strict=False)  # -> Index, Neighbour
cset_2 = CreateSet(List=fdom.Index)  # -> Set, Map
mindex_2 = MemberIndex(Set=fdom.Index, Member=cset_2.Set)  # -> Index, Count
partition_4 = PartitionList(List=sort.AVT, Size=mindex_2.Count)
partition_5 = PartitionList(List=sort.ValuesWATER, Size=mindex_2.Count)
partition_6 = PartitionList(List=sort.ValuesAVPH, Size=mindex_2.Count)
partition_7 = PartitionList(List=sort.ValuesNames, Size=mindex_2.Count)
partition_8 = PartitionList(List=sort.ValuesROOTS, Size=mindex_2.Count)
partition_9 = PartitionList(List=sort.ValuesHMAX, Size=mindex_2.Count)
partition_10 = PartitionList(List=sort.ValuesNUTRIENT, Size=mindex_2.Count)
partition_11 = PartitionList(List=sort.ValuesPLANTSPERSPECIES, Size=mindex_2.Count)
dup_4 = DuplicateData(Data=graft(partition_5), Number=graft(partition_11), Order=True)
dup_5 = DuplicateData(Data=graft(partition_6), Number=graft(partition_11), Order=True)
dup_6 = DuplicateData(Data=graft(partition_7), Number=graft(partition_11), Order=True)
dup_7 = DuplicateData(Data=graft(partition_8), Number=graft(partition_11), Order=True)
dup_8 = DuplicateData(Data=graft(partition_10), Number=graft(partition_11), Order=True)
dup_9 = DuplicateData(Data=graft(partition_9), Number=graft(partition_11), Order=True)
ma_5 = MassAddition(Input=partition_11)  # -> Result, PartialResults
partition_12 = PartitionList(List=flatten(ungroup), Size=flatten(ma_5.Result))
trim_10 = TrimTree(Tree=dup_4, Depth="2")

# ----
# Amount of water needed. Domains set every 100mm (100litres)
bnd_3 = Bounds(Numbers=flatten(water_mm))
dedomain_2 = DeconstructDomain(Domain=bnd_3)  # -> Start, End
division_6 = Division(A=dedomain_2.End, B="100")
series_2 = Series(Start=0, Step="100", Count=division_6)
addition_6 = Addition(A=series_2, B="100")
dom = ConstructDomain(DomainStart=series_2, DomainEnd=addition_6)
fdom_2 = FindDomain(Domains=dom, Number=trim_10, Strict=False)  # -> Index, Neighbour

trim_11 = TrimTree(Tree=dup_5, Depth="2")
trim_12 = TrimTree(Tree=dup_7, Depth="2")
trim_13 = TrimTree(Tree=dup_6, Depth="2")
trim_14 = TrimTree(Tree=dup_8, Depth="2")
trim_15 = TrimTree(Tree=dup_9, Depth="2")

# ----
# PH grouping
panel_7 = Panel("14")
division_7 = Division(A=panel_7, B="1")
series_3 = Series(Start=0, Step="1", Count=division_7)
addition_7 = Addition(A=series_3, B="1")
dom_2 = ConstructDomain(DomainStart=series_3, DomainEnd=addition_7)
fdom_3 = FindDomain(Domains=dom_2, Number=trim_11, Strict=False)  # -> Index, Neighbour

# ----
# ARRANGING BY PH
sort_2 = SortList(
    Keys=fdom_3.Index,
    ValuesWATER=fdom_2.Index,
    ValuesROOTS=trim_12,
    ValuesHMAX=trim_15,
    ValuesNUTRIENT=trim_14,
    ValuesSPECIES=trim_13)  # -> Keys, ValuesWATER, ValuesROOTS, ValuesHMAX, ValuesNUTRIENT, ValuesSPECIES

cset_3 = CreateSet(List=sort_2.Keys)  # -> Set, Map
mindex_3 = MemberIndex(Set=sort_2.Keys, Member=cset_3.Set)  # -> Index, Count
partition_13 = PartitionList(List=sort_2.Keys, Size=mindex_3.Count)
partition_14 = PartitionList(List=sort_2.ValuesWATER, Size=mindex_3.Count)
partition_15 = PartitionList(List=sort_2.ValuesROOTS, Size=mindex_3.Count)
partition_16 = PartitionList(List=sort_2.ValuesHMAX, Size=mindex_3.Count)
partition_17 = PartitionList(List=sort_2.ValuesNUTRIENT, Size=mindex_3.Count)
partition_18 = PartitionList(List=sort_2.ValuesSPECIES, Size=mindex_3.Count)
partition_19 = PartitionList(List=partition_12, Size=mindex_3.Count)

# ----
# ARRANGING BY ROOT SPACING
sort_3 = SortList(
    ROOTS=partition_15,
    ValuesWATER=partition_14,
    ValuesHMAX=partition_16,
    ValuesNUTRIENT=partition_17,
    ValuesSPECIES=partition_18)  # -> ROOTS, ValuesWATER, ValuesHMAX, ValuesNUTRIENT, ValuesSPECIES

# ----
# FUNKY WEAVING CLUSTER
weaving = WEAVING(L=sort_3.ROOTS)
weaving_2 = WEAVING(L=sort_3.ValuesWATER)

weaving_3 = WEAVING(L=sort_3.ValuesHMAX)
weaving_4 = WEAVING(L=sort_3.ValuesNUTRIENT)
weaving_5 = WEAVING(L=sort_3.ValuesSPECIES)
multiplication_6 = Multiplication(A=weaving, _15=1.5)

# ----
# HEIGHT
bnd_4 = Bounds(Numbers=flatten(height_max))
dedomain_3 = DeconstructDomain(Domain=bnd_4)  # -> Start, End
gradient = Gradient(
    LowerLimit=dedomain_3.Start,
    UpperLimit=dedomain_3.End,
    Parameter=weaving_3,
    stops=[0: RGB(255, 255, 255), 1: RGB(0, 0, 0)])

# ----
# NUTRIENTS
bnd_5 = Bounds(Numbers=flatten(series))
dedomain_4 = DeconstructDomain(Domain=bnd_5)  # -> Start, End
gradient_2 = Gradient(
    LowerLimit=dedomain_4.Start,
    UpperLimit=dedomain_4.End,
    Parameter=weaving_4,
    stops=[0: RGB(255, 0, 0), 0.2: RGB(0, 128, 0), 0.4: RGB(255, 255, 0), 0.6: RGB(255, 165, 0), 0.8: RGB(0, 0, 255), 1: RGB(255, 0, 255)])

# ----
# ROOTS DISTRIBUTION
bnd_6 = Bounds(Numbers=flatten(rooting))
dedomain_5 = DeconstructDomain(Domain=bnd_6)  # -> Start, End
gradient_3 = Gradient(
    LowerLimit=dedomain_5.Start,
    UpperLimit=dedomain_5.End,
    Parameter=weaving,
    stops=[0: RGB(0, 100, 0), 0.333: RGB(144, 238, 144), 0.667: RGB(127, 255, 212), 1: RGB(230, 230, 250)])

multiplication_7 = Multiplication(A=weaving_2, B="100")

# ----
# WATER DISTRIBUTION
bnd_7 = Bounds(Numbers=flatten(water_mm))
dedomain_6 = DeconstructDomain(Domain=bnd_7)  # -> Start, End
gradient_4 = Gradient(
    LowerLimit=dedomain_6.Start,
    UpperLimit=dedomain_6.End,
    Parameter=multiplication_7,
    stops=[0: RGB(255, 255, 255), 1: RGB(0, 0, 120)])

# ----
# PH DISTRIBUTION
bnd_8 = Bounds(Numbers=flatten(cset_3.Set))
dedomain_7 = DeconstructDomain(Domain=bnd_8)  # -> Start, End
gradient_5 = Gradient(
    LowerLimit=dedomain_7.Start,
    UpperLimit=dedomain_7.End,
    Parameter=partition_13,
    stops=[0: RGB(255, 0, 0), 0.5: RGB(255, 165, 0), 1: RGB(255, 255, 255)])

wbstellate = WeaverbirdsStellateCumulation(MeshPolylines=graft(partition_19), Distance=graft(multiplication_6))
wbcatmullclark = WeaverbirdsCatmullClarkSubdivision(MeshCurves=wbstellate, Level=1, SmoothNakedEdges=0)
area_2 = Area(Geometry=wbcatmullclark)  # -> Area, Centroid
facen = FaceNormals(Mesh=partition_19)  # -> Centers, Normals; disabled

num_3 = Number(expr("Round(x, 2)", area_2.Area))  # disabled
mesh_5 = Mesh(wbcatmullclark)
num_4 = Number(weaving)  # disabled

trim_16 = TrimTree(Tree=facen.Centers, Depth=1)  # disabled
tag = TextTag(Location=trim_16, Text=weaving_5)  # disabled
pshift_2 = ShiftPaths(Data=simplify(mesh_5), Offset="-1")
mcol_4 = MeshColours(Mesh=graft(mesh_5), Colours=graft(ColourSwatch(SwatchColor=RGB(204, 0, 255))))
mcol_5 = MeshColours(Mesh=pshift_2, Colours=graft(merge_4))
mcol_6 = MeshColours(Mesh=graft(mesh_5), Colours=graft(gradient_5))
mcol_7 = MeshColours(Mesh=graft(mesh_5), Colours=graft(gradient_3))
mcol_8 = MeshColours(Mesh=graft(mesh_5), Colours=graft(gradient_4))
mcol_9 = MeshColours(Mesh=graft(mesh_5), Colours=graft(gradient))
mcol_10 = MeshColours(Mesh=graft(mesh_5), Colours=graft(gradient_2))
filter_3 = StreamFilter(
    Gate=diagrams,
    Stream0=mcol_4,
    Stream1=mcol_5,
    Stream2=mcol_6,
    Stream3=mcol_7,
    Stream4=mcol_8,
    Stream5=mcol_9,
    Stream6=mcol_10)
mjoin = MeshJoin(Meshes=flatten(filter_3))
disjoint = DisjointMesh(Mesh=mjoin)  # -> simplify(graft(Meshes))
gate_4 = StreamGate(Stream=disjoint, Gate=aggregation)  # -> Target0, Target1
mjoin_2 = MeshJoin(Meshes=flatten(gate_4.Target1))  # disabled
disjoint_2 = DisjointMesh(Mesh=mjoin_2)  # -> simplify(graft(Meshes)); disabled
merge_8 = Merge(Data1=mesh_4, Data2=gate_4.Target1)
group_3 = Group(Objects=merge_8)  # -> flatten(Group)
lng_4 = ListLength(List=group_3)
partition_20 = PartitionList(List=box_6.Plane, Size=lng_4)
orient_4 = Orient(Geometry=group_3, Source=box_2.Plane, Target=partition_20)  # -> Geometry, Transform
ungroup_3 = Ungroup(Group=orient_4.Geometry)
lng_5 = ListLength(List=ungroup_3)
subtraction_4 = Subtraction(A=lng_5, B=1)
split_10 = SplitList(List=ungroup_3, Index=subtraction_4)  # -> ListA, ListB
mesh_6 = Mesh(split_10.ListA)
mesh_7 = Mesh(split_10.ListB)
filter_4 = StreamFilter(Gate=aggregation, Stream0=gate_2.Target0, Stream1=mesh_6)
filter_5 = StreamFilter(Gate=aggregation, Stream0=gate_4.Target0, Stream1=mesh_7)

# ---- group: RH_OUT:skin
mesh_8 = Mesh(flatten(filter_4))

# ---- group: RH_OUT:pots
mesh_9 = Mesh(flatten(filter_5))

# ==== cluster WEAVING
L = ClusterInput()
lng = ListLength(List=L)
division = Division(A=lng, B="3")
round = Round(Number=division)  # -> Nearest, Floor, Ceiling
partition = PartitionList(List=L, Size=round.Ceiling)
split = SplitTree(Data=partition, Masks=flatten("{*; 0}"))  # -> Positive, Negative
split_2 = SplitTree(Data=partition, Masks=flatten("{*; 1}"))  # -> Positive, Negative
split_3 = SplitTree(Data=partition, Masks=flatten("{*; 2}"))  # -> Positive, Negative
jitter = Jitter(List=split_2.Positive, Jitter=1, Seed=2)  # -> Values, Indices
rev = ReverseList(List=split_3.Positive)
panel = Panel("""0
1
2""")
weave = Weave(Pattern=panel, Stream0=split.Positive, Stream1=jitter.Values, Stream2=rev, NullGaps=False)
trim = TrimTree(Tree=weave, Depth="2")
T = ClusterOutput(trim)
